# Grasshopper definition GrasshopperBake-with-Serial-Number.ghx (Grasshopper 0.9.76)
# plug-ins: Python Interpreter

# ---- group: Create Box : U x V
series = Series(Start="10", Step="15", Count=Slider(4, range=0..10))
series_2 = Series(Start="10", Step="15", Count=Slider(6, range=0..10))
pt = ConstructPoint(XCoordinate=series, YCoordinate=0, ZCoordinate=0)
Y = UnitY(Factor=series_2)
graft = GraftTree(Tree=Y, IncludeEmptyLists=True, IncludeNullItems=True)
move = Move(Geometry=pt, Motion=graft)  # -> Geometry, Transform
pdecon = Deconstruct(Point=move.Geometry)  # -> XComponent, YComponent, ZComponent
xy = XYPlane(Origin=Point(0, 0, 0))
num = Number(pdecon.XComponent)
num_2 = Number(pdecon.YComponent)
xy_2 = XYPlane(Origin=move.Geometry)
division = Division(A=num, B="15")
division_2 = Division(A=num_2, B="15")
dist = Distance(PointA=xy, PointB=xy_2)
num_3 = Number(division)
num_4 = Number(division_2)
multiplication = Multiplication(A=dist, B=Slider(0.1, range=0..1))
neg = Negative(Value=num_3)
neg_2 = Negative(Value=num_4)
Z = UnitZ(Factor=multiplication)
dom = ConstructDomain(DomainStart=neg, DomainEnd=num_3)
dom_2 = ConstructDomain(DomainStart=neg_2, DomainEnd=num_4)
rectangle = Rectangle(Plane=xy_2, XSize=dom, YSize=dom_2, Radius=0)  # -> Rectangle, Length
boundary = BoundarySurfaces(Edges=rectangle.Rectangle)
extr = Extrude(Base=boundary, Direction=Z)

# ----
mesh = MeshBrep(
    Brep=extr,
    Settings={GridMaxCount=0, GridMinCount=16, JaggedSeams=False, MaxEdgeLength=0, MinEdgeLength=0.0001, MinTolerance=0, Refine=True, RefineAngle=0, RelativeTolerance=0.65, SimplePlanes=True, Tolerance=0})
flatten = FlattenTree(Tree=mesh, Path="{0}")
flatten_2 = FlattenTree(Tree=mesh, Path="{0}")
mesh_2 = Mesh(flatten_2)
mesh_3 = Mesh(flatten)
viewer = ParamViewer(mesh_3)
viewer_2 = ParamViewer(mesh_2)

# ---- group: Tree-Bake
mesh_4 = Mesh(mesh)
lng = ListLength(List=mesh_4)
flip = FlipMatrix(Data=mesh_4)
flatten_3 = FlattenTree(Tree=lng, Path="{0}")
lng_2 = ListLength(List=flip)
item = ListItem(List=flatten_3, Index="0", Wrap=True)
flatten_4 = FlattenTree(Tree=lng_2, Path="{0}")
item_2 = ListItem(List=flatten_4, Index="0", Wrap=True)
flatten_5 = FlattenTree(Tree=mesh_4, Path="{0}")
panel = Panel(item_2)
mesh_5 = Mesh(flatten_5)
python = PythonScript(Array=mesh_5, U=item, V=item_2, y=Toggle(True))  # -> out, a; inputs Array: list of Mesh
# ---------- python: Python ----------
# bake surfaces with simple materials
# input type - bool (Toggle)
import Rhino
import rhinoscriptsyntax as rs
import scriptcontext as sc

import rhinoscriptsyntax as rs
import ghpythonlib.components as ghpc

sc.doc = Rhino.RhinoDoc.ActiveDoc

len = ghpc.ListLength(Array)

if y == True:
    
    for i in range(len):
        
        Value = U*V
        
        num_1, hoge = divmod(i, U)
        str_1 = str(num_1)
        str_2 = str(i%U)
        
        selMesh = ghpc.ListItem(Array,i)
        
        str_name = str_1 + "_" +str_2
        
        sc.doc.Objects.AddMesh(selMesh)
        rs.Command(' _SelAll  _-Export '+ str_name+ '.stl _Enter _Enter _SelAll _Delete')
# ---------- end python ----------
brep = Brep(python.a)
preview = CustomPreview(Geometry=brep, Shader=ColourSwatch(SwatchColor=RGBA(0, 255, 255, 127)))
panel_2 = Panel(python.out)

# ----
viewer_3 = ParamViewer(mesh_4)

# ---- group: List-Bake
python_2 = PythonScript(Array=mesh_2, y=Toggle(False))  # -> out, a; inputs Array: list of Mesh
# ---------- python_2: Python ----------
# bake surfaces with simple materials
# input type - bool (Toggle)
import Rhino
import rhinoscriptsyntax as rs
import scriptcontext as sc

import rhinoscriptsyntax as rs
import ghpythonlib.components as ghpc

sc.doc = Rhino.RhinoDoc.ActiveDoc

len = ghpc.ListLength(Array)

if y == True:
    
    for i in range(len):
        
        selMesh = ghpc.ListItem(Array,i)
        
        str_name = "Test_" + str(i)
        
        sc.doc.Objects.AddMesh(selMesh)
        rs.Command(' _SelAll  _-Export '+ str_name+ '.stl _Enter _Enter _SelAll _Delete')
# ---------- end python_2 ----------
brep_2 = Brep(python_2.a)
preview_2 = CustomPreview(Geometry=brep_2, Shader=ColourSwatch(SwatchColor=RGBA(0, 255, 255, 127)))
panel_3 = Panel(python_2.out)

# ---- group: ListItem
python_3 = PythonScript(Array=mesh_3, i=Slider(0, range=0..100))  # -> out, a; inputs Array: list of Mesh
# ---------- python_3: Python ----------
import rhinoscriptsyntax as rs
import Grasshopper as gh
import ghpythonlib.components as ghpc

a = []

a = ghpc.ListItem(Array,i)
# ---------- end python_3 ----------
brep_3 = Brep(python_3.a)
preview_3 = CustomPreview(Geometry=brep_3, Shader=ColourSwatch(SwatchColor=RGBA(0, 255, 255, 127)))
panel_4 = Panel(python_3.a)
