# Grasshopper definition GrasshopperBake-with-SerialNumber.ghx (Grasshopper 0.9.76)
# plug-ins: Python Interpreter

# ---- group: Create Box : U x V
series = Series(Start="10", Step="15", Count=Slider(4, range=0..10))
series_2 = Series(Start="10", Step="15", Count=Slider(6, range=0..10))
pt = ConstructPoint(XCoordinate=series, YCoordinate=0, ZCoordinate=0)
Y = UnitY(Factor=series_2)
graft = GraftTree(Tree=Y, IncludeEmptyLists=True, IncludeNullItems=True)
move = Move(Geometry=pt, Motion=graft)  # -> Geometry, Transform
pdecon = Deconstruct(Point=move.Geometry)  # -> XComponent, YComponent, ZComponent
xy = XYPlane(Origin=Point(0, 0, 0))
num = Number(pdecon.XComponent)
num_2 = Number(pdecon.YComponent)
xy_2 = XYPlane(Origin=move.Geometry)
division = Division(A=num, B="15")
division_2 = Division(A=num_2, B="15")
dist = Distance(PointA=xy, PointB=xy_2)
num_3 = Number(division)
num_4 = Number(division_2)
multiplication = Multiplication(A=dist, B=Slider(0.1, range=0..1))
neg = Negative(Value=num_3)
neg_2 = Negative(Value=num_4)
Z = UnitZ(Factor=multiplication)
dom = ConstructDomain(DomainStart=neg, DomainEnd=num_3)
dom_2 = ConstructDomain(DomainStart=neg_2, DomainEnd=num_4)
rectangle = Rectangle(Plane=xy_2, XSize=dom, YSize=dom_2, Radius=0)  # -> Rectangle, Length
boundary = BoundarySurfaces(Edges=rectangle.Rectangle)
extr = Extrude(Base=boundary, Direction=Z)

# ----
mesh = MeshBrep(
    Brep=extr,
    Settings={GridMaxCount=0, GridMinCount=16, JaggedSeams=False, MaxEdgeLength=0, MinEdgeLength=0.0001, MinTolerance=0, Refine=True, RefineAngle=0, RelativeTolerance=0.65, SimplePlanes=True, Tolerance=0})
mesh_2 = Mesh(mesh)
mesh_3 = Mesh(mesh_2)
mesh_4 = Mesh(mesh_2)
flatten = FlattenTree(Tree=mesh_3, Path="{0}")
panel = Panel("C:\Users\yoshioca\Documents\GrasshopperBake-with-SerialNumber\List-Bake\")
panel_2 = Panel("C:\Users\yoshioca\Documents\GrasshopperBake-with-SerialNumber\Tree-Bake\")
flatten_2 = FlattenTree(Tree=mesh_4, Path="{0}")
python = PythonScript(TREE=mesh_4)  # -> out, flatten(U_COUNT); inputs TREE: list
# ---------- python: Python ----------
U_COUNT = len(TREE)

print U_COUNT
print "---"
# ---------- end python ----------
mesh_5 = Mesh(flatten_2)

# ---- group: LIST BAKE
python_2 = PythonScript(ARRAY=flatten, PATH=panel, BOOL=Toggle(False))  # -> out; inputs ARRAY: list of Mesh
# ---------- python_2: Python ----------
import Rhino
import rhinoscriptsyntax as rs
import scriptcontext as sc
import rhinoscriptsyntax as rs


sc.doc = Rhino.RhinoDoc.ActiveDoc


# print type(ARRAY)
# print len(ARRAY)


if BOOL == True:
    
    for i in xrange(len(ARRAY)):
        

        selMesh = ARRAY[i]
        # print selMesh
        
        sc.doc.Objects.AddMesh(selMesh)
        
        
        name = PATH + "Test_" + str(i)
        query = ' _SelAll  _-Export '+ name + '.stl _Enter _Enter _SelAll _Delete'
        
        rs.Command(query)
    
    print "Export"



sc.doc = Rhino.RhinoDoc.ActiveDoc
# ---------- end python_2 ----------

# ---- group: TREE BAKE
python_3 = PythonScript(ARRAY=mesh_5, U_COUNT=python.U_COUNT, PATH=panel_2, BOOL=Toggle(False))  # -> out; inputs ARRAY: list of Mesh, U_COUNT: list
# ---------- python_3: Python ----------
import Rhino
import rhinoscriptsyntax as rs
import scriptcontext as sc


# print ARRAY
# print type(ARRAY)
# print len(ARRAY)


sc.doc = Rhino.RhinoDoc.ActiveDoc

if BOOL == True:
    
    for i in xrange(len(ARRAY)):
        num_0, num_1 = divmod(i, U_COUNT[0])
        
        # print num_0, ",", num_1
        
        selMesh = ARRAY[i]
        sc.doc.Objects.AddMesh(selMesh)
        
        
        name = PATH + str(num_0) + "_" + str(num_1) + ".stl"
        query = ' _SelAll  _-Export '+ name+ ' _Enter _Enter _SelAll _Delete'
        print query
        rs.Command(query)


sc.doc = Rhino.RhinoDoc.ActiveDoc


print "export!"
# ---------- end python_3 ----------

# ----
panel_3 = Panel(python.U_COUNT)
panel_4 = Panel(python_2)
panel_5 = Panel(python_3)
